# Grasshopper definition simulating-the-street.gh (Grasshopper 1.0.7)

crossscandist = Slider(20, range=0..100)
vehscandist = Slider(20, range=0..30)
neighdist = Slider(3, range=0..20)
number_slider = Slider(99, range=0..100)  # disabled
number_slider_2 = Slider(0, range=0..10)  # disabled
number_slider_3 = Slider(100, range=0..500)  # disabled
number_slider_4 = Slider(100, range=0..500)  # disabled
number_slider_5 = Slider(0, range=0..10)  # disabled
number_slider_6 = Slider(6, range=0..10)  # disabled
number_slider_7 = Slider(1.172, range=0..10)  # disabled
number_slider_8 = Slider(1.647, range=0..10)  # disabled
button = Button()  # disabled
toggle = BooleanToggle(False)  # disabled
pt = Point([<point referenced from the Rhino model> x17])
pt_2 = Point([<point referenced from the Rhino model> x4])
pt_3 = Point([<point referenced from the Rhino model> x2])
pt_4 = Point(<point referenced from the Rhino model>)
pt_5 = Point(<point referenced from the Rhino model>)
pt_6 = Point([<point referenced from the Rhino model> x14])
pt_7 = Point([<point referenced from the Rhino model> x12])
pt_8 = Point([<point referenced from the Rhino model> x2])
pt_9 = Point(<point referenced from the Rhino model>)
pt_10 = Point(<point referenced from the Rhino model>)
pt_11 = Point([<point referenced from the Rhino model> x4])
pt_12 = Point([<point referenced from the Rhino model> x2])
trigger = Trigger(Interval=10, TimerInterval=10, Target=c_script)  # disabled
c_script = CSharpScript(
    reset=button,
    numOfBoids=number_slider,
    speed=number_slider_8,
    warp=toggle,
    sepDist=number_slider_5,
    sepWeight=number_slider_2,
    neighDist=number_slider_6,
    alignWeight=number_slider_7,
    xBound=number_slider_3,
    yBound=number_slider_4)  # -> out, A, B, C, D; inputs reset: Boolean, numOfBoids: Int32, speed: Double, warp: Boolean, sepDist: Double, sepWeight: Double, neighDist: Double, alignWeight: Double, xBound: Double, yBound: Double; disabled
# ---------- c_script: C# usings ----------
using System.Linq;
using System.Drawing;
# ---------- c_script: C# ----------
    if (!init || reset){
      rnd = new Random();
      myFlock = new Flock(numOfBoids, xBound, yBound, speed);
      init = true;
      bounds = new Rectangle3d(Plane.WorldXY, xBound, yBound);
    }

    myFlock.Update(sepDist, sepWeight, neighDist, alignWeight, xBound, yBound, warp);

    A = myFlock.myBoids.Select(x => x.pos).ToList();
    B = myFlock.myBoids.Select(x => x.vel).ToList();
    C = bounds;
    D = myFlock.myBoids.Select(x => new Circle(x.pos, sepDist)).ToList();
# ---------- c_script: C# additional code ----------
  bool init = false;
  Rectangle3d bounds;
  public static Random rnd;
  Flock myFlock;

  public class Boid{
    public Point3d pos;
    public Vector3d vel;
    public Vector3d acc;
    public double maxSpeed;

    public Boid(Point3d pos, Vector3d vel, double maxSpeed){
      this.pos = pos;
      this.vel = vel;
      this.maxSpeed = maxSpeed;
    }

    public void Separate(List<Boid> others, double sepDist, double sepWeight){

      int count = 0;
      var steer = Vector3d.Zero;
      foreach(var other in others){
        if (other == this) continue;

        var d = this.pos.DistanceTo(other.pos);

        if(d > 0 && d < sepDist){
          var away = this.pos - other.pos;
          away /= d;
          steer += away;
          count++;
        }
      }
      if (count > 0){
        steer /= count;
        if(steer.Length > 0){
          steer.Unitize();
          steer *= this.maxSpeed;
          steer -= this.vel;
        }
      }
      this.acc += steer * sepWeight;
    }

    public void Align(List<Boid> others, double neighDist, double alignWeight){
      int count = 0;
      var steer = Vector3d.Zero;
      foreach(var other in others){
        if (other == this) continue;

        var d = this.pos.DistanceTo(other.pos);
        if (d > 0 && d < neighDist){
          steer += other.vel;
          count++;
        }
      }
      if (count > 0){
        steer /= count;
        steer.Unitize();
        steer -= this.vel;
        this.acc += steer * alignWeight;
      }
    }

    public void Update(){
      this.vel += this.acc;
      if(vel.Length > maxSpeed){
        this.vel.Unitize();
        this.vel *= this.maxSpeed;
      }
      this.pos += this.vel;
      this.acc = Vector3d.Zero;
    }


    // we can remove the pos from the input because its already inside the Boid class
    public void WarpPosition(double maxX, double maxY, double sepDist){
      if (this.pos.X > (maxX - sepDist)){
        this.pos.X = sepDist;
      }else if (this.pos.X < sepDist){
        this.pos.X = maxX - sepDist;
      }
      if (this.pos.Y > (maxY - sepDist)){
        this.pos.Y = sepDist;
      }else if (this.pos.Y < sepDist){
        this.pos.Y = maxY - sepDist;
      }
      // we dont have to return pos, because we already apply the change to pos.
    }

    // we can remove vel as well as pos
    public void Reflect(double maxX, double maxY, double sepDist){
      if (this.pos.X > (maxX - sepDist) || this.pos.X < sepDist){
        this.vel.X *= -1;
      }
      if (this.pos.Y > (maxY - sepDist) || this.pos.Y < sepDist){
        this.vel.Y *= -1;
      }

      this.pos.X = Math.Max(sepDist, Math.Min(this.pos.X, (maxX - sepDist)));
      this.pos.Y = Math.Max(sepDist, Math.Min(this.pos.Y, (maxY - sepDist)));
    }
    // we dont have to return vel, because we already apply the change to vel.
  }

  public class Flock{
    public List<Boid> myBoids;

    public Flock(int count, double xMax, double yMax, double speed){
      myBoids = new List<Boid>();
      for (int i = 0; i < count; i++){
        var startPos = new Point3d(xMax * rnd.NextDouble(), yMax * rnd.NextDouble(), 0);
        var startVel = new Vector3d((rnd.NextDouble() - 0.5) * 2, (rnd.NextDouble() - 0.5) * 2, 0);
        startVel.Unitize();
        startVel *= speed;
        myBoids.Add(new Boid(startPos, startVel, speed));
      }
    }

    public void Update(double sepDist, double sepWeight, double neighDist, double alignWeight, double xMax, double yMax, bool warp){
      foreach(var boid in myBoids){
        boid.Separate(myBoids, sepDist, sepWeight);
        boid.Align(myBoids, neighDist, alignWeight);
      }
      foreach(var boid in myBoids){
        boid.Update();
        if(warp){
          boid.WarpPosition(xMax, yMax, sepDist * 0.5);
        }else{
          boid.Reflect(xMax, yMax, sepDist * 0.5);
        }
      }
    }
  }
# ---------- end c_script ----------
trigger_2 = Trigger(Interval=500, TimerInterval=500, Target=c_script_2)  # disabled
c_script_2 = CSharpScript(
    reset=Button(),
    On=Toggle(True),
    numPeds=Slider(300, range=0..500),
    numVehs=Slider(60, range=0..500),
    neighDist=neighdist,
    crossScanDist=crossscandist,
    vehScanDist=vehscandist,
    shops=pt,
    stationEnt=pt_2,
    stationExit=pt_3,
    busStop=pt_4,
    vehBusStop=pt_5,
    streetEnds=pt_6,
    objects=pt_7,
    signals=pt_8,
    vehStart0=pt_9,
    vehStart1=pt_10,
    vehEnds0=pt_11,
    vehEnds1=pt_12)  # -> out, A, B, C, D, E, F, G, H; inputs reset: Boolean, On: Boolean, numPeds: Int32, numVehs: Int32, neighDist: Double, crossScanDist: Double, vehScanDist: Double, shops: list of Point3d, stationEnt: list of Point3d, stationExit: list of Point3d, busStop: Point3d, vehBusStop: Point3d, streetEnds: list of Point3d, objects: list of Point3d, signals: list of Point3d, vehStart0: Point3d, vehStart1: Point3d, vehEnds0: list of Point3d, vehEnds1: list of Point3d
# ---------- c_script_2: C# ----------
    if (!init || reset){
      rnd = new Random();
      mySim = new Sim(
        numPeds,
        numVehs,
        shops,
        stationEnt,
        stationExit,
        busStop,
        streetEnds,
        objects,
        vehBusStop,
        vehStart0,
        vehEnds0,
        vehStart1,
        vehEnds1);
      init = true;
    }
    if (On){
      mySim.Update(neighDist, objects, crossScanDist, signals, vehScanDist);
      groupRects.Clear();
      vehRects.Clear();
      // peds group box drawing
      var uniqueIds = mySim.myPeds.Select(p => p.groupId).Distinct();
      // ped group rects
      foreach (var id in uniqueIds){
        var members = mySim.myPeds.Where(p => p.groupId == id).ToList();

        Point3d centre = new Point3d(0, 0, 0);
        foreach(var m in members){ centre.X += m.pos.X; centre.Y += m.pos.Y; }
        centre.X /= members.Count;
        centre.Y /= members.Count;

        Vector3d xAxis = new Vector3d(members[0].direction, 0, 0);
        Vector3d yAxis = new Vector3d(0, 1, 0);
        Plane rectPlane = new Plane(centre, xAxis, yAxis);

        double minX = members.Min(m => m.pos.X) - 0.3 - centre.X;
        double maxX = members.Max(m => m.pos.X) + 0.3 - centre.X;
        double minY = members.Min(m => m.pos.Y) - 0.3 - centre.Y;
        double maxY = members.Max(m => m.pos.Y) + 0.3 - centre.Y;

        groupRects.Add(new Rectangle3d(rectPlane, new Interval(minX, maxX), new Interval(minY, maxY)));
      }

      // veh rects
      foreach(var veh in mySim.myVehs){
        Vector3d dir = veh.vel;
        if (dir.Length < 0.001) dir = new Vector3d(veh.direction, 0, 0);
        dir.Unitize();
        Vector3d perp = Vector3d.CrossProduct(Vector3d.ZAxis, dir);
        Plane rectPlane = new Plane(veh.pos, dir, perp);

        double len = veh.isBus ? 10.0 : 5.0;
        double wid = veh.isBus ? 1.25 : 1.0;
        vehRects.Add(new Rectangle3d(rectPlane, new Interval(-len, 0), new Interval(-wid, wid)));
      }
    }

    A = mySim.myPeds.Where(x => !x.isReckless).Select(x => x.pos).ToList();
    B = mySim.myPeds.Where(x => !x.isReckless).Select(x => x.vel).ToList();
    C = mySim.myVehs.Select(x => x.pos).ToList();
    D = mySim.myVehs.Select(x => x.vel).ToList();
    E = groupRects;
    F = vehRects;
    G = mySim.myPeds.Where(x => x.isReckless).Select(x => x.pos).ToList();
    H = mySim.myPeds.Where(x => x.isReckless).Select(x => x.vel).ToList();
# ---------- c_script_2: C# additional code ----------
  bool init = false;
  public static Random rnd;
  List<Rectangle3d> groupRects = new List<Rectangle3d>();
  List<Rectangle3d> vehRects = new List<Rectangle3d>();
  Sim mySim;

  public class Pedestrians{

    // pos,vel, acc, and speed
    public Point3d pos;
    public Vector3d vel;
    public Vector3d acc;
    public double pedSpeed;

    // preset values
    public double maxPedSpeed = 1.5;
    public double minPedSpeed = 1.1;
    // public double crossScanDist = 20.0; // just using input
    // 2.2 s (from Zhao et al, 2019)* 8.94 m/s (speed limit 20 mph)~= 19.7,
    // then if there is no car in range of 20m circle, peds start to cross.
    // they mentioned that pedestrians accept a gap with 95% confidFence when gap > 2.2s (1-lane, ~4m crossing)

    //destination
    public List<Point3d> destinations; // set when spawn
    public List<string> destinationTypes; // "crossing", "bus", "final"
    public int destinationIndex = 0;
    public int direction; // set simultaneously

    //state
    public string state = "moving"; // moving or waiting or crossing or disappear.
    public string spawnSide; // south or north
    public bool isReckless; // 5% chance set at spawn
    public bool isDead = false; // appear or disappear
    public string stopReason = "";
    // if it stop (at a crossingpoint or bus stop), it will be assigned
    public int laneIndex;
    // 0-7, which walking lane (6m of width is devided by 7)

    //group
    public int groupSize; // 1,2,3,4
    public int groupId; // shared ID with group members who share speed, destination

    public Pedestrians(
      Point3d spawnPos,
      List<Point3d> destinations,
      List<string> destinationTypes,
      double pedSpeed,
      int laneIndex,
      int groupSize,
      int groupId,
      bool isReckless,
      string spawnSide)
    {
      this.pos = spawnPos;
      this.pedSpeed = pedSpeed;
      if (destinations[destinations.Count - 1].X > spawnPos.X) this.direction = 1;
      else this.direction = -1;
      this.vel = new Vector3d(direction * this.pedSpeed, 0, 0);

      this.destinations = destinations;
      this.destinationTypes = destinationTypes;
      this.laneIndex = laneIndex;
      this.spawnSide = spawnSide;
      this.isReckless = isReckless;

      this.groupSize = groupSize;
      this.groupId = groupId;
    }

    public void moving (List<Pedestrians> allPeds, double neighDist, List<Point3d> objects){
      this.SFM(allPeds, neighDist, objects);
      // state control
      if (destinationIndex < destinations.Count){
        Point3d current = destinations[destinationIndex];
        if (pos.DistanceTo(current) < 1.5){ // close enough
          string type = destinationTypes[destinationIndex];
          if (type == "crossing"){
            state = "waiting";
            stopReason = "crossing";
          }else if (type == "bus"){
            state = "waiting";
            stopReason = "bus";
          }else if (type == "final"){
            state = "disappear";
          }
          destinationIndex++;
        }
      }
    }

    public void waiting (List<Vehicles> allVehs, double crossScanDist){
      // stay until no cars in the range
      this.vel = Vector3d.Zero;
      bool isVeh = false;
      bool isBus = false;
      double min = double.MaxValue;

      Vehicles closestVeh = null;
      foreach(var veh in allVehs){
        var vehDist = this.pos.DistanceTo(veh.pos);
        if (vehDist < min){
          min = vehDist;
          closestVeh = veh;
        }
      }

      // cross if there is no vehicles.
      if (stopReason == "crossing"){
        if (!isReckless){
          if (min < crossScanDist) isVeh = true;
          if (!isVeh){
            this.state = "crossing";
          }else{
            if (closestVeh != null && closestVeh.state == "stopping") this.state = "crossing";
            else this.state = "waiting";
          }
        }else {
          if (min < 0.7 * crossScanDist) isVeh = true;
          if (!isVeh){
            this.state = "crossing";
          }else{
            if (closestVeh != null && closestVeh.state == "stopping") this.state = "crossing";
            else this.state = "waiting";
          }
        }
      }

      // wait until a bus comes.
      if (stopReason == "bus"){
        foreach(var veh in allVehs){
          if (veh.isBus && veh.state == "stopping"){
            isBus = true;
            break;
          }
        }
        // not done yet.
        if (isBus) this.state = "disappear";
        else this.state = "waiting";
      }
    }

    // go to the other side.
    public void crossing (){
      if (this.spawnSide == "south"){
        if (pos.Y > 29.0){
          spawnSide = "north";
          state = "moving";
        }
      }
      if (this.spawnSide == "north"){
        if (pos.Y < 20.0){
          spawnSide = "south";
          state = "moving";
        }
      }
    }

    // get inside the shop, go through the street, or ride on a bus.
    public void disappear (){
      this.isDead = true;
    }

    // Social Force Model (SFM)
    // Helbing, D. and Molnár, P. (1995) 'Social force model for pedestrian dynamics', Physical Review E, 51(5), pp. 4282–4286.
    public void SFM(List<Pedestrians> allPeds, double neighDist, List<Point3d> objects){
      var steer = Vector3d.Zero;
      var ahead = destinations[destinationIndex] - this.pos;
      var Dist = Math.Abs(this.pos.DistanceTo(destinations[destinationIndex]));
      ahead /= Dist;
      steer += ahead;
      // other pedestrians
      foreach(var ped in allPeds){
        if (ped == this || ped.groupId == this.groupId) continue;
        var d = this.pos.DistanceTo(ped.pos);
        var away = this.pos - ped.pos;
        away /= Math.Pow(d, 1.5);

        if(d > 0 && d < neighDist){
          steer += away;
        }
      }
      // objects
      foreach (var obj in objects){
        var away = this.pos - obj;
        var objDist = this.pos.DistanceTo(obj);
        away /= (objDist * objDist);
        if (objDist > 0 && objDist < 1.5){
          steer += away;
        }
      }
      // clamp
      double y;
      if (this.spawnSide == "south"){
        if (this.pos.Y > 17) y = 20;
        else y = 14;
      }else{
        if (this.pos.Y > 32) y = 35;
        else y = 29;
      }
      Point3d edgeP = new Point3d(this.pos.X, y, 0);
      var edgeDist = this.pos.DistanceTo(edgeP);
      var edge = this.pos - edgeP;
      edge /= edgeDist;
      if (edgeDist > 0 && edgeDist < 1.5){
        steer += edge;
      }
      if(steer.Length > 0){
        steer.Unitize();
        steer *= this.pedSpeed;
        steer -= this.vel;
      }
      this.acc += steer;
    }

    public void Update(
      List<Pedestrians> allPeds,
      double neighDist,
      List<Vehicles> allVehs,
      List<Point3d> objects,
    double crossScanDist){

      // moving
      if (state == "moving") {
        // update state
        moving(allPeds, neighDist, objects);
        // update pos, vel, acc
        this.vel += this.acc;
        if(this.vel.Length > this.pedSpeed){
          this.vel.Unitize();
          this.vel *= this.pedSpeed;
        }
        this.pos += this.vel;
        if (spawnSide == "south"){ // clamp
          this.pos.Y = Math.Max(14.0, Math.Min(this.pos.Y, 20.0));
        }else{
          this.pos.Y = Math.Max(29.0, Math.Min(this.pos.Y, 35.0));
        }
        this.acc = Vector3d.Zero;
      }

        // waiting
      else if (state == "waiting") {
        // update state
        waiting(allVehs, crossScanDist);
        // update pos, vel, acc
        this.vel = Vector3d.Zero;
        this.acc = Vector3d.Zero;
      }

        // crossing
      else if (state == "crossing") {
        // update state
        crossing();
        // update pos, vel, acc
        if (this.spawnSide == "south"){
          this.vel = new Vector3d(0, 1.5, 0);
          this.pos += this.vel;
          this.acc = Vector3d.Zero;
        }else if(this.spawnSide == "north"){
          this.vel = new Vector3d(0, -1.5, 0);
          this.pos += this.vel;
          this.acc = Vector3d.Zero;
        }
      }

        // disappear
      else if (state == "disappear") disappear();
    }
  }



  public class Vehicles{

    // pos,vel, acc, and speed
    public Point3d pos;
    public Vector3d vel;
    public double vehSpeed;
    public double spawnY;

    // preset values
    public double maxVehSpeed = 9.0; // max ~= 8.94 m/s (speed limit 20 mph)
    public double minVehSpeed = 8.0;
    public double frontScanDist = 20.0; // using input?

    // destination
    public List<Point3d> destinations; // set when spawn
    public int direction;
    public int destinationIndex = 0;
    public List<string> destinationTypes; // "snap", "bus", or "final"

    // state
    public string state = "moving"; // moving, stopping, or disappear.
    public string waitReason = ""; // "bus", "turning"
    public bool isDead = false; // appear or disappear
    public bool isBus = false; // bus or not.
    public int count = 0;
    public int timer = 0;

    public List<Vehicles> nearVeh = new List<Vehicles>();

    public Vehicles(
      Point3d spawnPos,
      List<Point3d> destinations,
      List<string> destinationTypes,
      double vehSpeed,
      bool isBus
    ){
      this.pos = spawnPos;
      this.spawnY = spawnPos.Y;
      this.vehSpeed = vehSpeed;
      if (destinations[destinations.Count - 1].X > spawnPos.X){
        direction = 1;
      } else {
        direction = -1;
      }
      this.vel = new Vector3d(direction * this.vehSpeed, 0, 0);
      this.destinations = destinations;
      this.destinationTypes = destinationTypes;
      this.isBus = isBus;
    }

    public bool scanning(
      List<Pedestrians> allPeds,
      List<Vehicles> allVehs,
      List<Point3d> signals,
    double vehScanDist){
      nearVeh.Clear();
      int num = 0;

      // scan pedestrians in rectangle-like shape.
      foreach (var ped in allPeds){
        bool near = false;
        if (direction == 1 ) {
          if (
            (ped.pos.X > this.pos.X && ped.pos.X < this.pos.X + vehScanDist)
            &&
            (ped.pos.Y > this.pos.Y - 3 && ped.pos.Y < this.pos.Y + 3))
            near = true;
        }else {
          if (
            (ped.pos.X > this.pos.X - vehScanDist && ped.pos.X < this.pos.X)
            &&
            (ped.pos.Y > this.pos.Y - 3 && ped.pos.Y < this.pos.Y + 3))
            near = true;
        }
        if (near && ped.state == "waiting" && ped.stopReason == "crossing")
          num++;
      }

      // scan vehicles in front of you.
      foreach (var veh in allVehs){
        if (this == veh) continue;
        bool near = false;
        if (direction == 1 ) {
          if (
            (veh.pos.X > this.pos.X && veh.pos.X < this.pos.X + vehScanDist)
            &&
            Math.Abs(this.pos.Y - veh.pos.Y) < 2)
            near = true;
        }else {
          if (
            (veh.pos.X > this.pos.X - vehScanDist && veh.pos.X < this.pos.X)
            &&
            Math.Abs(this.pos.Y - veh.pos.Y) < 2)
            near = true;
        }
        double angleV = Vector3d.VectorAngle(this.vel, new Vector3d(veh.pos - this.pos));
        if (near && angleV < 90){
          nearVeh.Add(veh);
          num++;
        }
      }

      // check signals
      if (direction == 1){
        //if (count % 40 > 20 && this.pos.DistanceTo(signals[0]) < 9){
        if (count % 20 > 10 && this.pos.DistanceTo(signals[0]) < 9){
          num++;
        }
      }else{
        //if (count % 40 > 20 && this.pos.DistanceTo(signals[1]) < 9){
        if (count % 20 > 10 && this.pos.DistanceTo(signals[1]) < 9){
          num++;
        }
      }
      if (num > 0) return false;
      else return true;
    }

    public void moving (bool isClear){
      // state control
      if (!isClear) state = "stopping";
      else if (destinationIndex < destinations.Count){
        Point3d current = destinations[destinationIndex];
        if (pos.DistanceTo(current) < 9){ // close enough
          string type = destinationTypes[destinationIndex];
          if (type == "snap"){
            state = "waiting";
          }else if (type == "bus"){
            state = "stopping";
          }else if (type == "final"){
            state = "disappear";
          }
          destinationIndex++;
        }
      }
    }

    public void waiting(bool isClear){
      if(isClear){
        state = "moving";
      }
    }


    public void stopping(List<Point3d> signals, bool isClear){
      bool nearSignal = false;
      if (destinationIndex < destinationTypes.Count){
        string type = destinationTypes[destinationIndex];
        if (direction == 1){
          if (pos.DistanceTo(signals[0]) < 9) nearSignal = true;
        }else{
          if (pos.DistanceTo(signals[1]) < 9) nearSignal = true;
        }

        // for cars
        if (!isBus){
          // scan peds and vehs
          if (isClear){
            // at the signal
            if (nearSignal){
              //if (count % 40 < 20){
              if (count % 20 < 10){
                state = "moving";
              }
            }else state = "moving";
          }
          // for buses
        }else if (type == "bus"){
          timer++; //
          //if (timer > 30 && isClear) {
          if (timer > 10 && isClear) {
            state = "moving";
            timer = 0;
          }
        }else if(isClear) state = "moving";
      }
    }

    // get to the end.
    public void disappear (){
      this.isDead = true;
    }

    public void Update(
      List<Pedestrians> allPeds,
      List<Vehicles> allVehs,
      List<Point3d> signals,
    double vehScanDist){

      bool isClear = scanning(allPeds, allVehs, signals, vehScanDist);

      // moving
      if (state == "moving"){
        moving(isClear);
        // keep same speed.
        if (destinationIndex < destinations.Count){
          if (nearVeh.Count > 0 && nearVeh[0].vel.Length < this.vel.Length){
            this.vel = nearVeh[0].vel;
          }else{
            this.vel = destinations[destinationIndex] - this.pos;
            this.vel.Unitize();
            this.vel *= vehSpeed;
          }
          this.pos += this.vel;
        }

        // waiting
      }else if (state == "waiting"){
        Point3d snap = destinations[destinationIndex - 1];
        this.pos = new Point3d(snap.X, this.spawnY, 0);
        this.vel = Vector3d.Zero;
        waiting(isClear);

        // stopping
      }else if (state == "stopping"){
        stopping(signals, isClear);
        this.vel = Vector3d.Zero;

        // disappear
      }else if (state == "disappear") disappear();

      // count up.
      count++;
    }
  }




  public class Sim{
    public List<Pedestrians> myPeds;
    public List<Vehicles> myVehs;
    public List<Vehicles> myPendingVehs;
    public double maxPedSpeed = 1.5;
    public double minPedSpeed = 1.1;
    public double maxVehSpeed = 9.0;
    public double minVehSpeed = 8.0;

    public Sim(
      int numPeds, int numVehs,
      List<Point3d> shops,
      List<Point3d> stationEnt,
      List<Point3d> stationExit,
      Point3d busStop,
      List<Point3d> streetEnds,
      List<Point3d> objects,
      Point3d vehBusStop,
      Point3d vehStart0,
      List<Point3d> vehEnds0,
      Point3d vehStart1,
      List<Point3d> vehEnds1
    ){
      // lists for peds
      List<Point3d> allPedsSpawns = new List<Point3d>();
      List<Point3d> allPedsDests = new List<Point3d>();
      List<string> allPedsDestTypes = new List<string>();

      // shops
      foreach (var p in shops){
        allPedsSpawns.Add(p);
        allPedsDests.Add(p);
        allPedsDestTypes.Add("final");
      }
      // station entrance
      foreach (var p in stationEnt){
        allPedsDests.Add(p);
        allPedsDestTypes.Add("final");
      }
      // station exit
      foreach (var p in stationExit){
        allPedsSpawns.Add(p);
      }
      // bus stop
      allPedsSpawns.Add(busStop);
      allPedsDests.Add(busStop);
      allPedsDestTypes.Add("bus");
      // ends
      foreach (var p in streetEnds){
        allPedsSpawns.Add(p);
        allPedsDests.Add(p);
        allPedsDestTypes.Add("final");
      }
      myPeds = new List<Pedestrians>();

      // lists for vehs
      List<Point3d> allVehDests0 = new List<Point3d>();
      List<Point3d> allVehDests1 = new List<Point3d>();

      foreach (var p in vehEnds0){
        allVehDests0.Add(p);
      }
      foreach (var p in vehEnds1){
        allVehDests1.Add(p);
      }


      // peds generation
      // group making
      int groupIdCounter = 0;
      int totalSpawned = 0;

      while (totalSpawned < numPeds){

        double roll = rnd.NextDouble();
        int groupSize;
        if (roll < 0.20) groupSize = 1;
        else if (roll < 0.60) groupSize = 2;
        else if (roll < 0.90) groupSize = 3;
        else                  groupSize = 4;
        int startLane = rnd.Next(0, 7 - groupSize + 1);

        // final destination
        int destIdx = rnd.Next(allPedsDests.Count);
        Point3d finalDest = allPedsDests[destIdx];
        string finalType = allPedsDestTypes[destIdx];

        // spawn
        Point3d spawn = allPedsSpawns[rnd.Next(allPedsSpawns.Count)];
        string spawnSide = (spawn.Y < 25) ? "south" : "north";
        double speed = minPedSpeed + rnd.NextDouble() * (maxPedSpeed - minPedSpeed);

        for (int m = 0; m < groupSize; m++){
          // spawn.Y
          int laneIndex = startLane + m;
          double spawnY;
          if (spawnSide == "south"){
            spawnY = 14.6 + 0.8 * laneIndex;
          }else{
            spawnY = 29.6 + 0.8 * laneIndex;
          }
          Point3d spawnPos = new Point3d(spawn.X, spawnY, 0);

          //waypoint list
          var dests = new List<Point3d>();
          var types = new List<string>();
          bool needsCrossing = Math.Abs(finalDest.Y - spawnPos.Y) > 9.0;
          if (needsCrossing){
            double crossingY = (spawnSide == "south") ? 20.0 : 29.0;
            double crossingX = finalDest.X - 5 + rnd.NextDouble() * 10;
            dests.Add(new Point3d(crossingX, crossingY, 0));
            types.Add("crossing");
          }
          dests.Add(finalDest);
          types.Add(finalType);

          // reckless
          bool isReckless = rnd.NextDouble() < 0.05;

          // build
          myPeds.Add(new Pedestrians(
            spawnPos, dests, types,
            speed,
            laneIndex, // laneIndex
            groupSize, // groupSize
            groupIdCounter,
            isReckless,
            spawnSide));

          totalSpawned++;
          if (totalSpawned >= numPeds) break;
        }
        groupIdCounter++;
      }


      // vehs generation
      myPendingVehs = new List<Vehicles>();
      myVehs = new List<Vehicles>();

      //from right to left: 0
      for (int i = 0;i < numVehs / 2; i++){
        // final destination
        int destIdx = rnd.Next(allVehDests0.Count);
        Point3d finalDest = allVehDests0[destIdx];
        string finalType = "final";

        // spawn
        Point3d spawnPos = vehStart0;
        double speed = minVehSpeed + rnd.NextDouble() * (maxVehSpeed - minVehSpeed);

        // destinations
        var dests = new List<Point3d>();
        var types = new List<string>();

        // is Bus
        bool isBus = rnd.NextDouble() < 0.05;
        if (isBus){
          dests.Add(vehBusStop);
          types.Add("bus");
        }

        // snap
        bool needsTurning = Math.Abs(finalDest.Y - spawnPos.Y) > 0.0;
        if (needsTurning){
          dests.Add(new Point3d(finalDest.X, spawnPos.Y, 0));
          types.Add("snap");
        }
        dests.Add(finalDest);
        types.Add(finalType);


        // build
        myPendingVehs.Add(new Vehicles(
          spawnPos,
          dests,
          types,
          speed,
          isBus
          ));
      }

      // from left to right: 1
      for (int i = 0; i < numVehs / 2;i++){
        // final destination
        int destIdx = rnd.Next(allVehDests1.Count);
        Point3d finalDest = allVehDests1[destIdx];
        string finalType = "final";

        // spawn
        Point3d spawnPos = vehStart1;
        double speed = minVehSpeed + rnd.NextDouble() * (maxVehSpeed - minVehSpeed);

        // destinations
        var dests = new List<Point3d>();
        var types = new List<string>();

        // is Bus
        bool isBus = rnd.NextDouble() < 0.05;

        // snap
        bool needsTurning = Math.Abs(finalDest.Y - spawnPos.Y) > 0.0;
        if (needsTurning){
          dests.Add(new Point3d(finalDest.X, spawnPos.Y, 0));
          types.Add("snap");
        }
        dests.Add(finalDest);
        types.Add(finalType);


        // build
        myPendingVehs.Add(new Vehicles(
          spawnPos,
          dests,
          types,
          speed,
          isBus
          ));
      }
      // shuffle the order of vehs in this list
      for (int i = myPendingVehs.Count - 1; i > 0; i--){
        int j = rnd.Next(i + 1);
        var temp = myPendingVehs[i];
        myPendingVehs[i] = myPendingVehs[j];
        myPendingVehs[j] = temp;
      }
    }


    public void Update(double neighDist, List<Point3d> objects, double crossScanDist, List<Point3d> signals, double vehScanDist){
      foreach(var ped in myPeds){
        ped.Update(myPeds, neighDist, myVehs, objects, crossScanDist);
      }
      myPeds.RemoveAll(p => p.isDead);
      for (int i = myPendingVehs.Count - 1; i >= 0; i--){
        if (rnd.NextDouble() < 0.50){
          myVehs.Add(myPendingVehs[i]);
          myPendingVehs.RemoveAt(i);
          break;
        }
      }
      foreach (var veh in myVehs){
        veh.Update(myPeds, myVehs, signals, vehScanDist);
      }
      myVehs.RemoveAll(p => p.isDead);
    }
  }
# ---------- end c_script_2 ----------
graft = GraftTree(Tree=c_script.A, IncludeEmptyLists=True, IncludeNullItems=True)  # disabled
cir = Circle(Plane=c_script.A, Radius=number_slider_6)  # disabled
number_slider_9 = Slider(0.3, range=0..1)
swatch = ColourSwatch(SwatchColor=RGB(0, 0, 255))
swatch_2 = ColourSwatch(SwatchColor=RGB(255, 0, 0))
swatch_3 = ColourSwatch(SwatchColor=RGB(0, 255, 0))
cir_2 = Circle(Plane=c_script_2.A, Radius=number_slider_9)
rec = DataRecorder(graft, DataLimit=-10, RecordData=True)  # disabled
cir_3 = Circle(Plane=c_script_2.G, Radius=number_slider_9)
pline = PolyLine(Vertices=rec, Closed=False)  # disabled
preview = CustomPreview(Geometry=c_script_2.E, Material=swatch)
preview_2 = CustomPreview(Geometry=c_script_2.F, Material=swatch_3)
preview_3 = CustomPreview(Geometry=cir_2, Material=swatch)
preview_4 = CustomPreview(Geometry=cir_3, Material=swatch_2)
vdisex = VectorDisplayEx(Point=c_script_2.A, Vector=c_script_2.B, Colour=swatch, Width=2)
vdisex_2 = VectorDisplayEx(Point=c_script_2.C, Vector=c_script_2.D, Colour=swatch_3, Width=2)
vdisex_3 = VectorDisplayEx(Point=c_script_2.G, Vector=c_script_2.H, Colour=swatch_2, Width=2)
